# Grasshopper definition Angled Boundingbox.ghx (Grasshopper 0.9.76)

crv = Curve(<curve referenced from the Rhino model>)
# How to get an angled bounding box.
cp = ControlPoints(Curve=crv)  # -> Points, Weights, Knots
cull_i = CullIndex(List=reverse(cp.Points), Indices=0, Wrap=True)  # -> reverse(List)
shift = ShiftList(List=cull_i, Shift=1, Wrap=True)
vec2pt = Vector2Pt(PointA=cull_i, PointB=shift, Unitize=False)  # -> Vector, Length
vlen = VectorLength(Vector=vec2pt.Vector)
vdis = VectorDisplay(Anchor=cull_i, Vector=vec2pt.Vector)
sort = SortList(Keys=vlen, ValuesA=vec2pt.Vector)  # -> Keys, reverse(ValuesA)
item = ListItem(List=sort.ValuesA, Index=0, Wrap=True)
Z = UnitZ(Factor=1)
vrot = Rotate(Vector=item, Axis=Z, Angle="Rad(90)")
pl = ConstructPlane(Origin=Point(0, 0, 0), XAxis=item, YAxis=vrot)
bbox = BoundingBox(Content=crv, Plane=pl)  # -> Box, Box_2
debrep = DeconstructBrep(Brep=bbox.Box)  # -> Faces, Edges, Vertices
area = Area(Geometry=debrep.Faces)  # -> Area, Centroid
sort_2 = SortList(Keys=area.Area, ValuesA=debrep.Faces)  # -> Keys, reverse(ValuesA)
item_2 = ListItem(List=sort_2.ValuesA, Index=0, Wrap=True)
crv_2 = Curve(item_2)
preview = CustomPreview(Geometry=crv_2, Shader=ColourSwatch(SwatchColor=RGB(0, 106, 255)))
