# Grasshopper definition Points Sort On Curve.ghx (Grasshopper 0.9.76)

# Sort Points on Curve
crv = Curve(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)
number_slider = Slider(1.7, range=0..10)
random = Random(Range=Domain(0, 1), Number=Slider(10, range=0..100), Seed=2)
eval = EvaluateLength(Curve=crv, Length=random, Normalized=True)  # -> Point, Tangent, Parameter
points = PointList(Points=eval.Point, Size=number_slider)
crv_2 = Curve(reparameterize(crv))
pt = Point(eval.Point)
crv_cp = CurveClosestPoint(Point=pt, Curve=crv_2)  # -> Point, Parameter, Distance
sort = SortList(Keys=crv_cp.Parameter, ValuesA=pt)  # -> Keys, ValuesA
points_2 = PointList(Points=sort.ValuesA, Size=number_slider)
