# Grasshopper definition Better Curve Offset Method.ghx (Grasshopper 1.0.4)

# Better way to offset curves
number_slider = Slider(100, range=0..100)
rectangle = Rectangle(Plane=PlaneXY(0, 0, 0), XSize=number_slider, YSize=number_slider, Radius=0)  # -> Rectangle, Length
pop2d = Populate2D(Region=rectangle.Rectangle, Count=Slider(100, range=0..100), Seed=1)
voronoi = Voronoi(Points=pop2d, Boundary=rectangle.Rectangle, BruteForceOverride=False)
crv = Curve(voronoi)
# Offset method 3 = Good!
area = Area(Geometry=crv)  # -> Area, Centroid
# Offset method 1 = Not good
neg = Negative(Value=Slider(1.8, range=0..10))
# Offset method 2 = Not good
neg_2 = Negative(Value=Slider(1.8, range=0..10))
python = GhPythonScript(crv=crv, dir=area.Centroid, dis=Slider(1.8, range=0..10))  # -> out, a
# ---------- python: Python ----------
__author__ = "jhorikawa"

import rhinoscriptsyntax as rs

a = rs.OffsetCurve(crv,dir,dis)
# ---------- end python ----------
offset_l = OffsetCurveLoose(Curve=voronoi, Distance=neg_2)
offset = OffsetCurve(Curve=voronoi, Distance=neg, Plane=PlaneXY(0, 0, 0), Corners=1)
