# Grasshopper definition Mesh Coloring.ghx (Grasshopper 1.0.4)

# How you can color mesh
mbox = MeshBox(Base={Plane=PlaneXY(0, 0, 0), X=Domain(-10, 10), Y=Domain(-10, 10), Z=Domain(-10, 10)}, XCount=10, YCount=10, ZCount=10)
demesh = DeconstructMesh(Mesh=mbox)  # -> Vertices, Faces, Colours, Normals
pdecon = Deconstruct(Point=demesh.Vertices)  # -> XComponent, YComponent, ZComponent
bnd = Bounds(Numbers=pdecon.XComponent)
bnd_2 = Bounds(Numbers=pdecon.YComponent)
bnd_3 = Bounds(Numbers=pdecon.ZComponent)
remap = RemapNumbers(Value=pdecon.XComponent, Source=bnd, Target=Domain(0, 1))  # -> Mapped, Clipped
remap_2 = RemapNumbers(Value=pdecon.YComponent, Source=bnd_2, Target=Domain(0, 1))  # -> Mapped, Clipped
remap_3 = RemapNumbers(Value=pdecon.ZComponent, Source=bnd_3, Target=Domain(0, 1))  # -> Mapped, Clipped
frgb = ColourRGBF(Alpha=1, Red=remap.Mapped, Green=remap_2.Mapped, Blue=remap_3.Mapped)
# First Method
mcol = MeshColours(Mesh=mbox, Colours=frgb)
# Second Method
conmesh = ConstructMesh(Vertices=demesh.Vertices, Faces=demesh.Faces, Colours=frgb)
