# Grasshopper definition Visualizing Volumetric Data.ghx (Grasshopper 1.0.4)
# plug-ins: GH_CPython

panel = Panel("C:/Users/jhorikawa/Desktop/3DShapeNets/volumetric_data/toilet/30/train/")
number_slider = Slider(10, range=0..10)
gh_cpython = GH_CPython(dir=panel, filename="toilet_000000523_12.mat", load=Button())  # -> output; inputs dir: list, filename: list, load: list
#   port output: indicate your output description here. refers to a new line.
# ---------- gh_cpython: Python ----------
import scipy.io

mat = scipy.io.loadmat(dir + filename)

output_ = mat["instance"].tolist()
# ---------- end gh_cpython ----------
number_slider_2 = Slider(30, range=0..100)
pt = ConstructPoint(XCoordinate=0, YCoordinate=0, ZCoordinate=0)
series = Series(Start=0, Step=number_slider, Count=number_slider_2)
int = Integer(gh_cpython)
X = UnitX(Factor=series)
Y = UnitY(Factor=series)
Z = UnitZ(Factor=series)
move = Move(Geometry=pt, Motion=X)  # -> Geometry, Transform
c_script = CSharpScript(d=int, n=number_slider_2)  # -> out, A; inputs d: list of Int32, n: Int32
# ---------- c_script: C# ----------
    DataTree<int> tree = new DataTree<int>();
    int count = 0;
    for(int i = 0; i < n; i++){
      for(int t = 0; t < n; t++){
        for(int s = 0; s < n; s++){
          GH_Path path = new GH_Path(i, t, s);
          tree.Add(d[count], path);
          count++;
        }
      }
    }
    
    A = tree;
# ---------- end c_script ----------
graft = GraftTree(Tree=move.Geometry, IncludeEmptyLists=True, IncludeNullItems=True)
move_2 = Move(Geometry=graft, Motion=Y)  # -> Geometry, Transform
graft_2 = GraftTree(Tree=move_2.Geometry, IncludeEmptyLists=True, IncludeNullItems=True)
move_3 = Move(Geometry=graft_2, Motion=Z)  # -> Geometry, Transform
graft_3 = GraftTree(Tree=move_3.Geometry, IncludeEmptyLists=True, IncludeNullItems=True)  # -> simplify(Tree)
cull = CullPattern(List=graft_3, CullPattern=c_script.A)
division = Division(A=number_slider, B=2)
box = CenterBox(Base=cull, X=division, Y=division, Z=division)
preview = CustomPreview(Geometry=box, Material=ColourSwatch(SwatchColor=RGB(18, 172, 255)))
