# Grasshopper definition Point Sort on a Plane.gh (Grasshopper 1.0.7)

random = Random(Range=Domain(0, 1), Number=Slider(3, range=0..10), Seed=Slider(41, range=0..100))  # -> graft(Random)
bang = ExplodeTree(Data=random)  # -> Branch0, Branch1, Branch2
vec = VectorXYZ(XComponent=bang.Branch0, YComponent=bang.Branch1, ZComponent=bang.Branch2)  # -> Vector, Length
polygon = Polygon(Plane=PlaneXY(0, 0, 0), Radius=3, Segments=Slider(8, range=0..10), FilletRadius=0)  # -> Polygon, Length
pl = PlaneNormal(Origin=Point(0, 0, 0), ZAxis=vec.Vector)
orient = Orient(Geometry=polygon.Polygon, Source=PlaneXY(0, 0, 0), Target=pl)  # -> Geometry, Transform
crv = Curve(orient.Geometry)
explode = Explode(Curve=crv, Recursive=True)  # -> Segments, Vertices
cull_i = CullIndex(List=explode.Vertices, Indices=0, Wrap=True)
lng = ListLength(List=cull_i)
random_2 = Random(Range=Domain(0, 1), Number=lng, Seed=2)
sort = SortList(Keys=random_2, ValuesA=cull_i)  # -> Keys, ValuesA

number_slider = Slider(1, range=0..10)
points = PointList(Points=sort.ValuesA, Size=number_slider)
avr = Average(Input=sort.ValuesA)
plfit = PlaneFit(Points=sort.ValuesA)  # -> Plane, Deviation
vec2pt = Vector2Pt(PointA=avr, PointB=sort.ValuesA, Unitize=False)  # -> Vector, Length
deplane = DeconstructPlane(Plane=plfit.Plane)  # -> Origin, XAxis, YAxis, ZAxis
vdis = VectorDisplay(Anchor=avr, Vector=vec2pt.Vector)
unit = UnitVector(Vector=vec2pt.Vector)
vdis_2 = VectorDisplay(Anchor=deplane.Origin, Vector=deplane.XAxis)
dprod = DotProduct(VectorA=deplane.XAxis, VectorB=unit, Unitize=False)
dprod_2 = DotProduct(VectorA=deplane.YAxis, VectorB=unit, Unitize=False)
python = GhPythonScript(x=dprod, y=dprod_2)  # -> out, a
# ---------- python: Python ----------
__author__ = "jhorikawa"
__version__ = "2020.07.27"

import rhinoscriptsyntax as rs
import math

a = math.atan2(x, y)
# ---------- end python ----------
deg = Degrees(Radians=python.a)
sort_2 = SortList(Keys=deg, ValuesA=sort.ValuesA)  # -> Keys, ValuesA
panel = Panel(deg)
tag = TextTag3D(Location=sort.ValuesA, Text=deg, Size=1, Justification=7)

shift = ShiftList(List=sort_2.ValuesA, Shift=Slider(1, range=0..10), Wrap=True)
rev = ReverseList(List=shift)

points_2 = PointList(Points=rev, Size=number_slider)
