# Grasshopper definition Point Distribution on Sphere.gh (Grasshopper 1.0.7)

rad = Radians(Degrees=Slider(5, range=0..10))
pi = Pi(Factor=1)
division = Division(A=pi, B=rad)
number_slider = Slider(100, range=0..100)
range = Range(Domain=pi, Steps=division)
cos = Cosine(Value=range)
sin = Sine(Value=range)
multiplication = Multiplication(A=number_slider, B=sin)
multiplication_2 = Multiplication(A=number_slider, B=cos)
pt = ConstructPoint(XCoordinate=multiplication_2, YCoordinate=multiplication, ZCoordinate=0)
multiplication_3 = Multiplication(A=multiplication, B="2")
pi_2 = Pi(Factor=1)
subset = SubList(List=pt, Domain="1", Wrap=True)  # -> List, Index
pline = PolyLine(Vertices=subset.List, Closed=False)
multiplication_4 = Multiplication(A=multiplication_3, B=pi_2)
len = Length(Curve=pline)
division_2 = Division(A=multiplication_4, B=len)
pi_3 = Pi(Factor="2")
round = Round(Number=division_2)  # -> Nearest, Floor, Ceiling
range_2 = Range(Domain=pi_3, Steps=round.Ceiling)  # -> simplify(Range)
graft = GraftTree(Tree=pt, IncludeEmptyLists=True, IncludeNullItems=True)
cull_i = CullIndex(List=range_2, Indices=0, Wrap=True)
yz = YZPlane(Origin=Point(0, 0, 0))
rotate = Rotate(Geometry=graft, Angle=cull_i, Plane=yz)  # -> Geometry, Transform
vec = Vector(rotate.Geometry)
unit = UnitVector(Vector=vec)
vec_2 = VectorXYZ(XComponent="1", YComponent="1", ZComponent="1")  # -> Vector, Length
addition = Addition(A=unit, B=vec_2.Vector)
multiplication_5 = Multiplication(A=addition, B="0.5")
devec = DeconstructVector(Vector=multiplication_5)  # -> XComponent, YComponent, ZComponent
frgb = ColourRGBF(Alpha=1, Red=devec.XComponent, Green=devec.YComponent, Blue=devec.ZComponent)
preview = CustomPreview(Geometry=rotate.Geometry, Material=frgb)
