# Grasshopper definition Grasshopper Player Handson.gh (Grasshopper 1.0.7)

crv = Curve(<curve referenced from the Rhino model>)
get_geometry = GetGeometry(crv, AtLeast=1, AtMost=1, Filter=1073741828, Prompt="Set curve")
get_number = GetNumber(Slider(300, range=0..1000), AtLeast=1, AtMost=1, Maximum=1000, Minimum=1, Prompt="Set depth")
get_number_2 = GetNumber(Slider(150, range=0..1000), AtLeast=1, AtMost=1, Maximum=1000, Minimum=1, Prompt="Set height")
get_number_3 = GetNumber(Slider(600, range=0..1000), AtLeast=1, AtMost=1, Maximum=1000, Minimum=1, Prompt="Set width")
divdist = DivideDistance(Curve=get_geometry, Distance=get_number)  # -> Points, Tangents, Parameters
Z = UnitZ(Factor=1)
pi = Pi(Factor=0.5)
vrot = Rotate(Vector=divdist.Tangents, Axis=Z, Angle=pi)
pl = ConstructPlane(Origin=divdist.Points, XAxis=divdist.Tangents, YAxis=vrot)
lng = ListLength(List=pl)
division = Division(A=get_number, B="2")
division_2 = Division(A=get_number_3, B="2")
division_3 = Division(A=get_number_2, B="2")
series = Series(Start=0, Step=get_number_2, Count=lng)
Z_2 = UnitZ(Factor=series)
move = Move(Geometry=pl, Motion=Z_2)  # -> Geometry, Transform
box = CenterBox(Base=move.Geometry, X=division, Y=division_2, Z=division_3)
context_bake = ContextBake(Geometry=box)
