# Grasshopper definition Curved Folding.gh (Grasshopper 0.9.76)
# plug-ins: MeshEdit Components, Python Interpreter, Kangaroo Components, Kangaroo2 Components, ExportLegs

number_slider = Slider(100, range=0..100)
number_slider_2 = Slider(1, range=0..10)
number_slider_3 = Slider(30, range=0..30)
crv = Curve(<curve referenced from the Rhino model>)
planesrf = PlaneSurface(Plane=PlaneXY(0, 0, 0), XSize=number_slider, YSize=number_slider)
sdivide = DivideSurface(Surface=planesrf, UCount=number_slider_2, VCount=number_slider_3)  # -> simplify(Points), Normals, Parameters
addition = Addition(A=number_slider_2, B=1)
addition_2 = Addition(A=number_slider_3, B=1)
frompoints = MeshFromPoints(Points=flatten(sdivide.Points), UDirection=addition, VDirection=addition_2)  # -> simplify(Mesh)
meshtonurb = MeshToNurb(m=frompoints)  # -> out, a
# ---------- meshtonurb: Python ----------
import rhinoscriptsyntax as rs

a = rs.MeshToNurb(m)
# ---------- end meshtonurb ----------
number_slider_4 = Slider(0, range=0..150)  # disabled
number_slider_5 = Slider(90, range=0..90)  # disabled
pt = Point([<point referenced from the Rhino model> x2])  # disabled
crv_2 = Curve(<curve referenced from the Rhino model>)  # disabled
extr = ExtrudePoint(Base=crv_2, Point=pt)  # disabled
debrep = DeconstructBrep(Brep=meshtonurb.a)  # -> Faces, Edges, Vertices
bcx = BrepCurve(Brep=meshtonurb.a, Curve=crv)  # -> Curves, Points
join = BrepJoin(Breps=extr)  # -> Breps, Closed; disabled
number_slider_6 = Slider(1, range=0..1)  # disabled
end = EndPoints(Curve=crv_2)  # -> Start, End; disabled
item = ListItem(List=pt, Index=0, Wrap=True)  # disabled
item_2 = ListItem(List=pt, Index=1, Wrap=True)  # disabled
srfsplit = SurfaceSplit(Surface=debrep.Faces, Curves=bcx.Curves)
rad = Radians(Degrees=number_slider_4)  # disabled
rad_2 = Radians(Degrees=number_slider_4)  # disabled
edges = BrepEdges(Brep=join.Breps)  # -> Naked, Interior, NonManifold; disabled
explode = Explode(Curve=srfsplit, Recursive=True)  # -> simplify(Segments), Vertices
smesh = SimpleMesh(Brep=join.Breps)  # disabled
toggle = BooleanToggle(True)
number_slider_7 = Slider(1, range=0..1)  # disabled
anchor = Anchor(Point=item, Strength=10000)  # disabled
number_slider_8 = Slider(170, range=0..170)
timer = Timer(TimerInterval=500, Target=counter)  # disabled
end_2 = EndPoints(Curve=explode.Segments)  # -> Start, End
merge = Merge(Data1=edges.Naked, Data2=edges.Interior)  # disabled
floor = Floor(Strength=1)  # disabled
ph = PlasticHinge(FoldStart=end.Start, FoldEnd=end.End, Tip1=item, Tip2=item_2, RestAngle=rad, Limit=rad_2, Strength=number_slider_6)  # disabled
counter = Counter(Reset=toggle)
show = Show(G=smesh)  # disabled
ln = Line(StartPoint=end_2.Start, EndPoint=end_2.End)
flatten = FlattenTree(Tree=ln, Path="{0}")
length_line = LengthLine(Line=merge, Length=merge, Strength=number_slider_7)  # disabled
multiplication = Multiplication(A=counter, B=Slider(0.01, range=0..0.01))
join_2 = JoinCurves(Curves=ln, Preserve=False)  # -> simplify(Curves)
boundary = BoundarySurfaces(Edges=join_2)
pshift = ShiftPaths(Data=boundary, Offset=-1)
item_3 = ListItem(List=pshift, Index=1, Wrap=True)
item_4 = ListItem(List=pshift, Index=0, Wrap=True)
flip = Flip(Surface=item_3)  # -> Surface, Result
merge_2 = Merge(Data1=item_4, Data2=flip.Surface)
dupln = RemoveDuplicateLines(Lines=flatten, Tolerance=0.01)
flip_2 = FlipMatrix(Data=merge_2)
number_slider_9 = Slider(1, range=0..1)
merge_3 = Merge(Data1=flatten(show), Data2=flatten(ph), Data3=flatten(length_line), Data4=flatten(anchor), Data5=flatten(floor))  # disabled
multiplication_2 = Multiplication(A=multiplication, B=number_slider_8)
toggle_2 = BooleanToggle(True)  # disabled
button = Button()  # disabled
length_line_2 = LengthLine(Line=dupln, Strength=10)
join_3 = BrepJoin(Breps=flip_2)  # -> Breps, Closed
min = Minimum(A=multiplication_2, B=number_slider_8)
panel = Panel(min)
pshift_2 = ShiftPaths(Data=join_2, Offset=-1)
boundary_2 = BoundarySurfaces(Edges=pshift_2)
smesh_2 = SimpleMesh(Brep=join_3.Breps)
solver = Solver(GoalObjects=merge_3, Reset=button, Threshold=1e-15, Tolerance=0.01, On=toggle_2)  # -> I, V, O; disabled
join_4 = BrepJoin(Breps=boundary_2)  # -> Breps, Closed
edges_2 = BrepEdges(Brep=join_4.Breps)  # -> Naked, Interior, NonManifold
meshnormalize = MeshNormalize(mesh=smesh_2)  # -> out, A; inputs mesh: Mesh
# ---------- meshnormalize: C# ----------
    if(mesh != null){
      mesh.Normals.ComputeNormals();

      A = mesh;
    }
# ---------- end meshnormalize ----------
box_corners = BoxCorners(Box=join_4.Breps)  # -> CornerA, CornerB, CornerC, CornerD, CornerE, CornerF, CornerG, CornerH
rad_3 = Radians(Degrees=min)
item_5 = ListItem(List=solver.O, Index=0, Wrap=True)  # disabled
ln_2 = Line(StartPoint=box_corners.CornerF, EndPoint=box_corners.CornerG)
ln_3 = Line(StartPoint=box_corners.CornerA, EndPoint=box_corners.CornerD)
join_5 = JoinCurves(Curves=flatten(edges_2.Interior), Preserve=False)
end_3 = EndPoints(Curve=edges_2.Interior)  # -> Start, End
flatten_2 = FlattenTree(Tree=ln_3, Path="{0}")
flatten_3 = FlattenTree(Tree=ln_2, Path="{0}")
explode_2 = Explode(Curve=join_5, Recursive=True)  # -> Segments, Vertices
crv_3 = Curve(<curve referenced from the Rhino model>)  # disabled
shift = ShiftList(List=explode_2.Segments, Shift=-1, Wrap=False)
shift_2 = ShiftList(List=explode_2.Segments, Shift=1, Wrap=False)
shift_3 = ShiftList(List=flatten_2, Shift=-1, Wrap=False)
shift_4 = ShiftList(List=flatten_2, Shift=1, Wrap=False)
shift_5 = ShiftList(List=flatten_3, Shift=-1, Wrap=False)
shift_6 = ShiftList(List=flatten_3, Shift=1, Wrap=False)
explode_3 = Explode(Curve=crv_3, Recursive=True)  # -> Segments, Vertices; disabled
graft = GraftTree(Tree=shift_2, IncludeEmptyLists=True, IncludeNullItems=True)  # -> simplify(Tree)
graft_2 = GraftTree(Tree=shift, IncludeEmptyLists=True, IncludeNullItems=True)  # -> simplify(Tree)
graft_3 = GraftTree(Tree=shift_4, IncludeEmptyLists=True, IncludeNullItems=True)  # -> simplify(Tree)
number_slider_10 = Slider(1, range=0..1)
graft_4 = GraftTree(Tree=shift_3, IncludeEmptyLists=True, IncludeNullItems=True)  # -> simplify(Tree)
graft_5 = GraftTree(Tree=shift_6, IncludeEmptyLists=True, IncludeNullItems=True)  # -> simplify(Tree)
graft_6 = GraftTree(Tree=shift_5, IncludeEmptyLists=True, IncludeNullItems=True)  # -> simplify(Tree)
number_slider_11 = Slider(0, range=0..180)  # disabled
ph_2 = PlasticHinge(
    FoldStart=end_3.Start,
    FoldEnd=end_3.End,
    Tip1=box_corners.CornerD,
    Tip2=box_corners.CornerF,
    RestAngle=rad_3,
    Limit=rad_3,
    Strength=number_slider_9)
ph_3 = PlasticHinge(
    FoldStart=end_3.Start,
    FoldEnd=end_3.End,
    Tip1=box_corners.CornerA,
    Tip2=box_corners.CornerG,
    RestAngle=rad_3,
    Limit=rad_3,
    Strength=number_slider_9)
number_slider_12 = Slider(1, range=0..1)  # disabled
shift_7 = ShiftList(List=explode_3.Segments, Shift=-1, Wrap=False)  # disabled
shift_8 = ShiftList(List=explode_3.Segments, Shift=1, Wrap=False)  # disabled
angle = Angle(VectorA=graft_4, VectorB=graft_3)  # -> Angle, Reflex
show_2 = Show(G=crv_3)  # disabled
angle_2 = Angle(VectorA=graft_6, VectorB=graft_5)  # -> Angle, Reflex
angle_3 = Angle(VectorA=graft_2, VectorB=graft)  # -> Angle, Reflex
graft_7 = GraftTree(Tree=shift_8, IncludeEmptyLists=True, IncludeNullItems=True)  # -> simplify(Tree); disabled
graft_8 = GraftTree(Tree=shift_7, IncludeEmptyLists=True, IncludeNullItems=True)  # -> simplify(Tree); disabled
angle_4 = Angle(LineA=graft_4, LineB=graft_3, Strength=number_slider_10)
angle_5 = Angle(LineA=graft_2, LineB=graft, RestAngle=angle_3.Angle, Strength=Slider(1, range=0..1))
angle_6 = Angle(LineA=graft_6, LineB=graft_5, Strength=number_slider_10)
rad_4 = Radians(Degrees=number_slider_11)  # disabled
floor_2 = Floor(Strength=1)
angle_7 = Angle(LineA=graft_8, LineB=graft_7, RestAngle=rad_4, Strength=number_slider_12)  # disabled
button_2 = Button()  # disabled
toggle_3 = BooleanToggle(True)  # disabled
show_3 = Show(G=meshnormalize.A)
merge_4 = Merge(Data1=angle_4, Data2=angle_6, Data3=angle_5)
merge_5 = Merge(Data1=flatten(show_2), Data2=flatten(angle_7))  # disabled
merge_6 = Merge(
    Data1=flatten(show_3),
    Data2=flatten(length_line_2),
    Data3=flatten(ph_3),
    Data4=flatten(ph_2),
    Data5=flatten(merge_4),
    Data6=flatten(floor_2))
solver_2 = Solver(GoalObjects=merge_6, Reset=Button(), Threshold=1e-15, Tolerance=0.01, On=Toggle(True))  # -> I, V, O
solver_3 = Solver(GoalObjects=merge_5, Reset=button_2, Threshold=1e-15, Tolerance=0.01, On=toggle_3)  # -> I, V, O; disabled
item_6 = ListItem(List=solver_2.O, Index=0, Wrap=True)
subset = SubList(List=solver_2.O, Domain=Domain(0, 1), Wrap=True)  # -> List, Index
item_7 = ListItem(List=solver_3.O, Index=0, Wrap=True)  # disabled
weldvertices = MeshWeldVertices(Mesh=subset.List, Tolerance=0.01)  # -> RuntimeMessage, Mesh
preview = CustomPreview(Geometry=subset.List, Shader=ColourSwatch(SwatchColor=RGB(97, 221, 255)))
not = GateNot(A=toggle)
export = Export(MeshObject=weldvertices.Mesh, FileDir="D:\User\Desktop\animation\animation", SaveFile=not, Timeline=counter)
